# Grasshopper definition GSS_GRID_2019.gh (Grasshopper 1.0.7)
# plug-ins: Weaverbird, Shortest Walk in Gh

number_slider = Slider(10, range=0..10)
number_slider_2 = Slider(5, range=0..10)
recgrid = Rectangular(Plane=PlaneXY(0, 0, 0), SizeX=number_slider_2, SizeY=number_slider_2, ExtentX=number_slider, ExtentY=number_slider)  # -> Cells, flatten(Points)

genes = GenePool(
    Decimals=2,
    Maximum=1.001,
    Minimum=1,
    Value=[1.001, 1.001, 1.001, 1.0005, 1.0005, 1.0005, 1.0005, 1.0005, 1.0005, 1.0005])
genes_2 = GenePool(
    Decimals=2,
    Maximum=1,
    Minimum=0,
    Value=[0.28, 0.61, 0.4024350724, 0.14, 0.32, 0.9912277423, 0.7019077859, 0.4946900678, 0.4087933956, 0.01854637359])
pt = ConstructPoint(XCoordinate=genes, YCoordinate=genes_2, ZCoordinate=0)

explode = Explode(Curve=recgrid.Cells, Recursive=True)  # -> Segments, Vertices

genes_3 = GenePool(Decimals=2, Maximum=1, Minimum=0, Value=[0.26, 0.24, 0.25, 0.24, 0.25, 0.22, 0.3, 0.33, 0.26, 0.3224814461])
genes_4 = GenePool(Decimals=2, Maximum=0.001, Minimum=0, Value=[0, 0, 0, 0.0005, 0.0005, 0.0005, 0.0005, 0.0005, 0.0005, 0.0005])
pt_2 = ConstructPoint(XCoordinate=genes_4, YCoordinate=genes_3, ZCoordinate=0)

wbweave = WeaverbirdsMeshFromLinesWeaveBack(Lines=explode.Segments, MaximumValence=4)  # -> flatten(Mesh)
hull = ConvexHull(Points=recgrid.Points, Plane=PlaneXY(0, 0, 0))  # -> Hull, HullZ, Indices
mjoin = MeshJoin(Meshes=wbweave)
wbtriangles = WeaverbirdsSplitTrianglesSubdivision(MeshCurves=mjoin, Level=1)
boundary = BoundarySurfaces(Edges=hull.Hull)
evalsrf = EvaluateSurface(Surface=reparameterize(boundary), Point=pt)  # -> Point, Normal, UDirection, VDirection, Frame
evalsrf_2 = EvaluateSurface(Surface=reparameterize(boundary), Point=pt_2)  # -> Point, Normal, UDirection, VDirection, Frame
wbedges = WeaverbirdsMeshEdges(MeshOrPolylines=wbtriangles)  # -> flatten(Lines)
crv_cp = CurveClosestPoint()  # -> Point, Parameter, Distance
ln = Line(StartPoint=evalsrf.Point, EndPoint=evalsrf_2.Point)
hframe = HorizontalFrame(Curve=wbedges, Parameter=Slider(0.5, range=0..1))
deplane = DeconstructPlane(Plane=hframe)  # -> Origin, XAxis, YAxis, ZAxis
X = UnitX(Factor=1)
line = LineSDL(Start=hframe, Direction=deplane.XAxis, Length=1)
angle = Angle(VectorA=line, VectorB=X)  # -> Angle, Reflex
equals = Equality(FirstNumber=angle.Angle, SecondNumber=Slider(0, range=0..100))  # -> Equality, Inequality
cull = CullPattern(List=wbedges, CullPattern=invert(equals.Equality))
shortwalk = ShortestWalk(Curves=cull, WantedPath=ln)  # -> ShortestWalk, Succession, Direction, Length
