# Grasshopper definition 190701-GH-NDVI.gh (Grasshopper 1.0.7)
# plug-ins: MeshEdit Components, RasterGrid, NDVIColorRange, NDVICalculator, ReadRasterData

test_jpg = Panel("C:\Users\Aldo Sollazzo\Desktop\IAAC-GSS2019\gss2019\remote-sensing\images\test.JPG")
raster = ReadRaster(ImagePath=test_jpg, RunRaster=Toggle(True))  # -> XYSize, ImageDriver, BANDs, Metadata, R, G, B
grid = RasterGrid(XYSize=raster.XYSize)
ndvical = NDVICalculator(NIR=raster.B, VIS=raster.R)
dedomain = DeconstructDomain(Domain=raster.XYSize)  # -> Start, End
multiplication = Multiplication(A=ndvical, B="4")
ndvicolor = NDVIColorRange(NDVI=multiplication)
multiplication_2 = Multiplication(A=multiplication, B=Slider(100, range=0..100))
Z = UnitZ(Factor=multiplication_2)
move = Move(Geometry=grid, Motion=Z)  # -> Geometry, Transform
frompoints = MeshFromPoints(Points=move.Geometry, UDirection=dedomain.End, VDirection=dedomain.Start, Colour=ndvicolor)
